# Grasshopper definition Curve Test.gh (Grasshopper 0.9.76)

crv = Curve(<curve referenced from the Rhino model>)
cp = ControlPoints(Curve=crv)  # -> Points, Weights, Knots
pt2num = PointsToNumbers(Points=graft(cp.Points), Mask=4)
panel = Panel("""a
b
c
d
e
f
g""")
wrapper = Wrapper(wrap="[", content=pt2num, join=",")
wrapper_2 = Wrapper(wrap="[", content=flatten(wrapper), join=",")
panel_2 = Panel("""geometry
type
properties""")
wrapper_3 = Wrapper(wrap="\"", content=panel)
json = JSONWrite(key="degree", value="3")
merge = Merge(Data1=flatten(wrapper_2), Data2=flatten("cpCurve"), Data3=flatten(json))
wrapper_4 = Wrapper(wrap="[", content=wrapper_3, join=",")
panel_3 = Panel("C:\Users\_s-abutler\AppData\Roaming\Grasshopper\UserObjects\componentLibrary")
json_2 = JSONWrite(key=panel_2, value=merge)
panel_4 = Panel(wrapper_4)
file_write = FileWrite(content=json_2, file_path=panel_3, T="curve.json", activate=Toggle(True))
jsonr = JSONRead(object=json_2, key="geometry")  # -> simplify(value)
jsonr_2 = JSONRead(object=json_2, key="properties.degree")  # -> simplify(value)
rep = ReplaceText(Text=jsonr, Find="[", RecursiveReplace=False)
panel_5 = Panel(jsonr_2)
rep_2 = ReplaceText(Text=rep, Find="]", RecursiveReplace=False)
split = TextSplit(Text=rep_2, Separators=",")
pt2num_2 = NumbersToPoints(Numbers=split, Mask=4)
nurbs = NurbsCurve(Vertices=pt2num_2, Degree=jsonr_2, Periodic=False)  # -> Curve, Length, Domain
panel_6 = Panel(pt2num_2)

# ==== cluster Wrapper: Wraps data with a wrapping character
join = ClusterInput()  # Join character
content = ClusterInput()  # Content to be wrapped
wrap = ClusterInput()  # Wrap character or XML tag
txt = Text(join)
null = NullItem(Item=txt)  # -> NullFlags, InvalidFlags, Description
data = Data(content)
tmatch = MatchText(Text=wrap, RegEx="<*.>", Case=True)
bool = Boolean(null.NullFlags)
dispatch = Dispatch(List=data, DispatchPattern=bool)  # -> ListA, ListB
item = ListItem(List=wrap, Index=0, Wrap=True)
split = TextSplit(Text=item, Separators=" ")
join_2 = TextJoin(Text=dispatch.ListB, Join=txt)
panel = Panel("""{
[
(
"
'""")
panel_2 = Panel("""{█}
[█]
(█)
"█"
'█'""")
item_2 = ListItem(List=split, Index=0, Wrap=True)
weave = Weave(Pattern=bool, Stream0=join_2, Stream1=dispatch.ListA, NullGaps=False)
data_2 = Data(wrap)
replace = ReplaceMembers(Set=data_2, Find=panel, Replace=panel_2)
rep = ReplaceText(Text=item_2, Find="<", Replace="</", RecursiveReplace=False)
expression = Expression(x=item, y=rep, Expression="Format(\"{0}█{1}>\", x, y)")
rep_2 = ReplaceText(Text=expression, Find=">>", Replace=">", RecursiveReplace=False)
weave_2 = Weave(Pattern=tmatch, Stream0=replace, Stream1=rep_2, NullGaps=False)
rep_3 = ReplaceText(Text=weave_2, Find="█", Replace=weave, RecursiveReplace=False)
data_3 = Data(rep_3)
wrapped = ClusterOutput(data_3)  # Wrapped Output

# ==== cluster JSONWrite: Create a JSON from keys and values
key = ClusterInput()  # List of keys
value = ClusterInput()  # List of values
txt = Text(value)
python = PythonScript(key=key, value=txt)  # -> objects; inputs key: list, value: list
# ---------- python: Python ----------
import json
object = {}
for keys,values in zip(key,value):
    try:
        valueIns = json.loads(values)
    except ValueError:
        print('Value Error')
        valueIns = values
    object[keys] = valueIns

print object
objects= str(json.dumps(object, separators=(',',':')))
# ---------- end python ----------
object = ClusterOutput(python)  # JSON Object Out

# ==== cluster JSONRead: Return value from JSON object by key
object = ClusterInput()  # JSON object to read from
key = ClusterInput()  # Key to retrieve
python = PythonScript(x=graft(object), y=key)  # -> a
# ---------- python: Python ----------
import json

def dictFindConv (findString):
	findString = findString.split(".")
	findStringIndex = 0
	for i in findString:
		findString[findStringIndex] = '["'+i+'"]'
		findStringIndex += 1
	fDat = "".join(findString)
	return fDat

object = json.loads(x)
print (y)
exec('jObject = (object'+dictFindConv(y)+')')
print(type(jObject) is dict)
if (type(jObject) is dict) or (type(jObject) is list):
    print("OBJ")
    a = str(json.dumps(jObject, separators=(',',':')))
else:
    print("STR")
    a =jObject
# ---------- end python ----------
value = ClusterOutput(python)  # Value output
panel = Panel(python)

# ==== cluster FileWrite
content = ClusterInput()
file_path = ClusterInput()
activate = ClusterInput()
T = ClusterInput()
content_2 = Data(content)
file_path_2 = Text(file_path)
join = TextJoin(Text=[file_path_2, T], Join="\")
vb = VBScript(path=simplify(join), lines=simplify(content_2), activate=activate)  # -> out, A
# ---------- vb: VB ----------
    If (activate = True)
      
      system.IO.File.WriteAllText(path, lines)
      A = "File written"
    Else
      A = "Not activated"
    End If
# ---------- end vb ----------
